# Grasshopper definition llm_requests_windows_EP.gh (Grasshopper 1.0.8)
# plug-ins: Heteroptera, Human UI, Pufferfish, Bifocals, ShapeDiverForGrasshopper

shapediver_document_payload = ShapeDiverDocumentPayload({AbsoluteTolerance=0, AngleTolerance=0, DistanceDisplayPrecision=0, GltfVersion="Gltf2", GrasshopperVersion="1.0.0008", InputGroups="{}", OutputGroups="{}", RelativeTolerance=0, RhinoVersion="8.18.25100.11001", UnitSystem=0, VersionCreated="1.26.0.0", VersionSaved="1.26.0.0"})

location = Slider(1, range=0..3)
stretch = Slider(1.3, range=0.2..2.5)

vertical = Slider(0.7, range=0..1)
horizontal = Slider(0.2, range=0..1)

panel = Panel("how do i bake cookies?")  # disabled

create_text_box = CreateTextBox(Label="Update Shading Depth in m.", DefaultText="0.1", UpdateButton=True, showLabel=True)
create_slider = CreateSlider(Slider=location, ShowBounds=False, ShowTicks=False, ShowTooltip=False, ShowValLabel=True, showLabel=True)
create_label = CreateLabel(LabelText="Shade", LabelSize=Slider(15, range=10..50), Justification=Slider(1, range=0..2))
merge = Merge(Data1=create_label, Data2=create_slider, Data3=create_text_box)
create_stack = CreateStack(UIElements=merge, Horizontal=Toggle(False))
create_border = CreateBorder(
    UIElement=create_stack,
    BorderThickness=Slider(0.1, range=0.1..4),
    BorderColor=RGB(0, 0, 0),
    CornerRadius=Slider(16, range=1..50))

create_text_box_2 = CreateTextBox(Label="Type desired WWR", DefaultText="0.1", UpdateButton=True, showLabel=True)
create_slider_2 = CreateSlider(Slider=stretch, ShowBounds=False, ShowTicks=False, ShowTooltip=False, ShowValLabel=True, showLabel=True)
create_slider_3 = CreateSlider(Slider=vertical, ShowBounds=False, ShowTicks=False, ShowTooltip=False, ShowValLabel=True, showLabel=True)
create_slider_4 = CreateSlider(Slider=horizontal, ShowBounds=False, ShowTicks=False, ShowTooltip=False, ShowValLabel=True, showLabel=True)
create_label_2 = CreateLabel(LabelText="Window", LabelSize=Slider(15, range=10..50), Justification=Slider(1, range=0..2))
merge_2 = Merge(Data1=create_label_2, Data2=create_slider_2, Data3=create_slider_4, Data4=create_slider_3, Data5=create_text_box_2)
create_stack_2 = CreateStack(UIElements=merge_2, Horizontal=Toggle(False))
create_border_2 = CreateBorder(
    UIElement=create_stack_2,
    BorderThickness=Slider(0.1, range=0.1..4),
    BorderColor=RGB(0, 0, 0),
    CornerRadius=Slider(16, range=1..50))

panel_2 = Panel("50")
concatenate = Concatenate(FragmentA=panel_2, FragmentB=" %")
create_label_3 = CreateLabel(LabelText=concatenate, LabelSize=12, Justification=Slider(0, range=0..2))
create_label_4 = CreateLabel(LabelText=" Unit SDA", LabelSize=Slider(15, range=10..50), Justification=Slider(1, range=0..2))
merge_3 = Merge(Data1=create_label_4, Data2=create_label_3)
create_stack_3 = CreateStack(UIElements=merge_3, Horizontal=Toggle(False))
create_border_3 = CreateBorder(
    UIElement=create_stack_3,
    BorderThickness=Slider(0.1, range=0.1..4),
    BorderColor=RGB(0, 0, 0),
    CornerRadius=Slider(16, range=1..50))

python_3_script = Python3Script(input_text=panel, run=Toggle(False))  # -> out, out_2; disabled
# ---------- python_3_script: Python ----------
#r: requests

import requests

url = 'http://localhost:5000/llm_call'
payload = {'input': input_text}


out = None
if run:
    response = requests.post(url, json=payload)

    if response.status_code == 200:
        data = response.json()
        out = data['response']
    else:
        out = "Failed to connect:"

a = out
# ---------- end python_3_script ----------

# ----
# Create Display Window
number_slider = Slider(800, range=0..1000)
launch_window = LaunchWindow(
    Show=Toggle(True),
    Name="Facade Generator",
    Width=Slider(640, range=0..1000),
    Height=number_slider,
    FontFamily="Arial",
    ChildStatus=0,
    EnableHorizScroll=False)

panel_3 = Panel("san diego, california")  # disabled
boolean_toggle = BooleanToggle(False)  # disabled
panel_4 = Panel(python_3_script.out_2)  # disabled
python_3_script_2 = Python3Script(input_text=panel_3, run=boolean_toggle)  # -> out, min_range, max_range, description; disabled
# ---------- python_3_script_2: Python ----------
#r: requests

import requests

url = 'http://localhost:5000/llm_call'
payload = {'input': input_text}


out = None
if run:
    response = requests.post(url, json=payload)

    if response.status_code == 200:
        data = response.json()
        out = data['response']
    else:
        out = "Failed to connect:"


print(out)
# ---------- end python_3_script_2 ----------

value_listener = ValueListener(Elements=create_slider, SomeProperty=True)  # -> Values, Indices
value_listener_2 = ValueListener(Elements=create_text_box, SomeProperty=True)  # -> Values, Indices

value_listener_3 = ValueListener(Elements=create_slider_2, SomeProperty=True)  # -> Values, Indices
value_listener_4 = ValueListener(Elements=create_slider_4, SomeProperty=True)  # -> Values, Indices
value_listener_5 = ValueListener(Elements=create_slider_3, SomeProperty=True)  # -> Values, Indices
value_listener_6 = ValueListener(Elements=create_text_box_2, SomeProperty=True)  # -> Values, Indices

panel_5 = Panel(python_3_script_2.description)
panel_6 = Panel(python_3_script_2.out)
panel_7 = Panel(python_3_script_2.max_range)
panel_8 = Panel(python_3_script_2.min_range)
number_slider_2 = Slider(3, range=0..10)
construct_point = ConstructPoint(XCoordinate=Slider(23, range=5..30), YCoordinate=0, ZCoordinate=0)
rectangle = Rectangle(Plane=construct_point, XSize=number_slider_2, YSize=number_slider_2, Radius=0)  # -> Rectangle, Length
curve = Curve(rectangle.Rectangle)
curve_2 = Curve(curve)
boundary_surfaces = BoundarySurfaces(Edges=curve)
area = Area(Geometry=curve_2)  # -> Area, Centroid
construct_point_2 = ConstructPoint(XCoordinate=value_listener_4.Values, YCoordinate=value_listener_5.Values, ZCoordinate=0)
multiplication = Multiplication(A=area.Area, B=value_listener_6.Values)
panel_9 = Panel(multiplication)
division = Division(A=multiplication, B=value_listener_3.Values)
evaluate_surface = EvaluateSurface(Surface=reparameterize(curve), Point=construct_point_2)  # -> Point, Normal, UDirection, VDirection, Frame
point = Point(evaluate_surface.Point)

negative = Negative(Value=division)
negative_2 = Negative(Value=value_listener_3.Values)
division_2 = Division(A=division, B="2")
division_3 = Division(A=value_listener_3.Values, B="2")
division_4 = Division(A=negative, B="2")
division_5 = Division(A=negative_2, B="2")
construct_domain = ConstructDomain(DomainStart=division_2, DomainEnd=division_4)
construct_domain_2 = ConstructDomain(DomainStart=division_3, DomainEnd=division_5)
rectangle_2 = Rectangle(Plane=point, XSize=construct_domain_2, YSize=construct_domain, Radius=0)  # -> Rectangle, Length

curve_3 = Curve(rectangle_2.Rectangle)

# ----
# Out of bounds filter
offset_curve = OffsetCurve(Curve=boundary_surfaces, Distance=Slider(-0.2, range=-0.2..2), Corners=1)
boundary_surfaces_2 = BoundarySurfaces(Edges=offset_curve)
discontinuity = Discontinuity(Curve=curve_3, Level=1)  # -> Points, Parameters
radians = Radians(Degrees="90")
pull_point = PullPoint(Point=discontinuity.Points, Geometry=boundary_surfaces_2, ClosestOnly=True)  # -> ClosestPoint, Distance, Index
rotate_3d = Rotate3D(Geometry=offset_curve, Angle=radians, Center=Point(0, 0, 0), Axis="1,0,0")  # -> Geometry, Transform
smaller_than = SmallerThan(FirstNumber=pull_point.Distance, SecondNumber="0.01")  # -> SmallerThan, OrEqualTo
smaller_than_2 = SmallerThan(FirstNumber=pull_point.Distance, SecondNumber="0.01")  # -> SmallerThan, OrEqualTo
smaller_than_3 = SmallerThan(FirstNumber=pull_point.Distance, SecondNumber="0.01")  # -> SmallerThan, OrEqualTo
panel_10 = Panel(smaller_than.SmallerThan)
boolean = Boolean(smaller_than_3.SmallerThan)
equality = Equality(FirstNumber=panel_10, SecondNumber="True")  # -> Equality, Inequality
mass_addition = MassAddition(Input=boolean)  # -> Result, PartialResults
panel_11 = Panel(equality.Equality)
panel_12 = Panel(mass_addition.Result)
equality_2 = Equality(FirstNumber=mass_addition.Result, SecondNumber="4")  # -> Equality, Inequality
panel_13 = Panel(equality_2.Equality)
stream_filter = StreamFilter(Gate=equality_2.Equality, Stream0="Out of bounds")
panel_14 = Panel(stream_filter)

region_intersection = RegionIntersection(CurvesA=curve_3, CurvesB=curve)
region_difference = RegionDifference(CurvesA=curve, CurvesB=curve_3)
curve_4 = Curve(region_intersection)
curve_5 = Curve(region_difference)
explode = Explode(Curve=curve_4, Recursive=True)  # -> Segments, Vertices
unit_z = UnitZ(Factor=value_listener_2.Values)
list_item = ListItem(List=explode.Segments, Index=value_listener.Values, Wrap=True)
extrude = Extrude(Base=list_item, Direction=unit_z)
boundary_surfaces_3 = BoundarySurfaces(Edges=curve_5)
boundary_surfaces_4 = BoundarySurfaces(Edges=curve_4)
clean_tree = CleanTree(RemoveNulls=True, RemoveInvalid=True, RemoveEmpty=False, Tree=extrude)

# ----
# Rotate 3D geometry
panel_15 = Panel("90")
radians_2 = Radians(Degrees=panel_15)
radians_3 = Radians(Degrees="90")
radians_4 = Radians(Degrees="90")
rotate_3d_2 = Rotate3D(Geometry=boundary_surfaces_3, Angle=radians_2, Center=Point(0, 0, 0), Axis="1,0,0")  # -> Geometry, Transform
rotate_3d_3 = Rotate3D(Geometry=clean_tree, Angle=radians_3, Center=Point(0, 0, 0), Axis="1,0,0")  # -> Geometry, Transform
rotate_3d_4 = Rotate3D(Geometry=boundary_surfaces_4, Angle=radians_4, Center=Point(0, 0, 0), Axis="1,0,0")  # -> Geometry, Transform

boundary_surfaces_5 = BoundarySurfaces(Edges=flatten([curve, boundary_surfaces]))
python_3_script_3 = Python3Script(input_text="san diego, california", run=Toggle(False))  # -> out, points
# ---------- python_3_script_3: Python ----------
#r: requests

import requests
from ghpythonlib.treehelpers import list_to_tree

url = 'http://localhost:5000/llm_call'
payload = {'input': input_text}


out = None
if run:
    response = requests.post(url, json=payload)

    if response.status_code == 200:
        data = response.json()
        out = data['response']
    else:
        out = "Failed to connect:"

try:
    print(out)
    text = out.splitlines()
    point1 = []
    for t in text:
        t = t.replace("[","")
        t = t.replace("]","")
        print(t)
        x, y = t.split(",")
        point1.append([x,y])

    points = list_to_tree(point1)
except Exception as e:
    # simple print
    print("Caught exception:", e)
    print("Incorrect format")
# ---------- end python_3_script_3 ----------
deconstruct_brep = DeconstructBrep(Brep=boundary_surfaces)  # -> Faces, Edges, Vertices
number = Number(python_3_script_3.points)
custom_preview = CustomPreview(Geometry=boundary_surfaces_5, Material=ColourSwatch(SwatchColor=RGB(145, 140, 140)))
panel_16 = Panel(number)
list_item_2 = ListItem(List=deconstruct_brep.Vertices, Index=Slider(2, range=0..10), Wrap=True)
custom_preview_2 = CustomPreview(Geometry=rotate_3d_2.Geometry, Material=ColourSwatch(SwatchColor=RGB(255, 255, 255)))
custom_preview_3 = CustomPreview(Geometry=rotate_3d_3.Geometry, Material=ColourSwatch(SwatchColor=RGB(203, 99, 255)))
custom_preview_4 = CustomPreview(Geometry=rotate_3d_4.Geometry, Material=ColourSwatch(SwatchColor=RGB(120, 241, 255)))
unit_x = UnitX(Factor=1)
area_2 = Area(Geometry=curve_4)  # -> Area, Centroid
area_3 = Area(Geometry=boundary_surfaces)  # -> Area, Centroid
move = Move(Geometry=list_item_2, Motion=unit_x)  # -> Geometry, Transform
division_6 = Division(A=area_2.Area, B=area_3.Area)
round_to_decimal_place = RoundToDecimalPlace(NumberX=division_6, DecimalPlace="2", RoundType=0)  # -> Rounded, Difference
xy_plane = XYPlane(Origin=move.Geometry)
radians_5 = Radians(Degrees="90")
rotate_3d_5 = Rotate3D(Geometry=xy_plane, Angle=radians_5, Center=Point(0, 0, 0), Axis="1,0,0")  # -> Geometry, Transform
concatenate_2 = Concatenate(Fragment_A="WWR", Fragment_B=round_to_decimal_place.Rounded, A=stream_filter)
panel_17 = Panel(round_to_decimal_place.Rounded)
list_item_3 = ListItem(Index=Slider(2, range=0..10), Wrap=True)
panel_18 = Panel(concatenate_2)
panel_19 = Panel(list_item_3)
panel_20 = Panel(division_6)
panel_21 = Panel(concatenate_2)
text_tag_3d = TextTag3D(Location=rotate_3d_5.Geometry, Text=concatenate_2, Size=Slider(0.4, range=0..1), Justification=7)
concatenate_3 = Concatenate(FragmentA="shading depth in meters: ", FragmentB=panel_19)
boolean_toggle_2 = BooleanToggle(False)

# ----
# City + Send Button
panel_22 = Panel("New York")
create_text_box_3 = CreateTextBox(Label="Your location", DefaultText=panel_22, UpdateButton=invert(True), showLabel=True)
create_button = CreateButton(ButtonName="Send", ButtonStyle=0)
value_listener_7 = ValueListener(Elements=create_text_box_3, SomeProperty=True)  # -> Values, Indices
value_listener_8 = ValueListener(Elements=create_button, SomeProperty=True)  # -> Values, Indices
create_stack_4 = CreateStack(UIElements=[create_text_box_3, create_button], Horizontal=True)
stream_freeze_gate = StreamFreezeGate(Data=value_listener_7.Values, PassingSwitch=value_listener_8.Values, Freeze=True)
stream_freeze_gate_2 = StreamFreezeGate(Data=value_listener_8.Values, PassingSwitch=True)
panel_23 = Panel(value_listener_8.Values)
panel_24 = Panel(value_listener_7.Values)
panel_25 = Panel(stream_freeze_gate)
panel_26 = Panel(stream_freeze_gate_2)

data_recorder = DataRecorder(value_listener_8.Values, DataLimit=-10, RecordData=True)
panel_29 = Panel(concatenate_3)
panel_30 = Panel(panel_18)
python_3_script_4 = Python3Script(
    city=stream_freeze_gate,
    WWR=flatten(panel_30),
    shading_depth=flatten(panel_29),
    orientation="south",
    run=stream_freeze_gate_2)  # -> out, answer, numbers; inputs city: String, WWR: String
# ---------- python_3_script_4: Python ----------
#r: requests

import requests
from ghpythonlib.treehelpers import list_to_tree

url = 'http://localhost:5000/llm_call'

input_text = f"I have a midrise apartment building in the city of {city}. This is the current window properties, it has the WWR (window to wall ratio) and shading depth for shading device above the window: {WWR}, {shading_depth}, {orientation} facing orientation"

print(input_text)

payload = {'input': input_text}

out = None
if run:
    response = requests.post(url, json=payload)

    if response.status_code == 200:
        data = response.json()
        out = data['response']
    else:
        out = "Failed to connect:"

answer = out

try:
    print(out)
    text = out.splitlines()
    numbers = [] 
    for i,t in enumerate(text): 
        if i <2: 
            number = t.split(":")[1] 
            numbers.append(number)
            print(number)
except Exception as e:
    # simple print
    print("Caught exception:", e)
    print("Incorrect format")
# ---------- end python_3_script_4 ----------
panel_31 = Panel(python_3_script_4.answer)

# ----
# Bot - City
number_slider_3 = Slider(0, range=0..2)
create_text_block = CreateTextBlock(TextSize=12, Justification=number_slider_3)
create_label_5 = CreateLabel(LabelText="Copilot Message", LabelSize=12, Justification=number_slider_3)
create_scroll_viewer = CreateScrollViewer(
    UIElements=create_text_block,
    HorizontalScrollBarVisibility=0,
    VerticalScrollBarVisibility=0,
    Width=Slider(400, range=0..1000),
    Height=Slider(200, range=0..1000))
panel_32 = Panel(panel_31)
create_stack_5 = CreateStack(UIElements=[create_label_5, create_scroll_viewer], Horizontal=Toggle(False))
set_textblock_contents = SetTextBlockContents(TextBlockToModify=create_text_block, NewTextBlockContents=panel_32)

# ----
# Human UI
merge_4 = Merge(Data1=create_stack_4, Data2=create_stack_5, Data3=create_border_2, Data4=create_border, Data5=create_border_3)
add_elements = AddElements(Window=launch_window, Elements=flatten(merge_4), DoVLChecking=True)  # -> AddedElements, ElementNames

panel_33 = Panel(python_3_script_4.out)
panel_34 = Panel(python_3_script_4.numbers)
list_item_4 = ListItem(List=panel_34, Index=0, Wrap=True)  # -> Item, Item1
wwr = Panel(list_item_4.Item)
shading_depth_in_m = Panel(list_item_4.Item1)
panel_35 = Panel("""Left
Up
Right""")
list_item_5 = ListItem(List=panel_35, Index=Slider(0, range=0..2), Wrap=True)
panel_36 = Panel(list_item_5)

# ----
# Material Suggestion
panel_37 = Panel("""Brick
Stone
Metal""")
create_pulldown_menu = CreatePulldownMenu(Label="Material Suggestions", ListItems=panel_37, showLabel=True)

# ----
# Chat - User Message
panel_38 = Panel("[Insert text here]")
create_text_box_4 = CreateTextBox(Label="User Message", DefaultText=panel_38, UpdateButton=invert(True), showLabel=True)
create_button_2 = CreateButton(ButtonName="Send", ButtonStyle=0)
create_stack_6 = CreateStack(UIElements=[create_text_box_4, create_button_2], Horizontal=True)

create_text_box_5 = CreateTextBox(Label="User Message", UpdateButton=invert(True), showLabel=True)
create_button_3 = CreateButton(ButtonName="Send", ButtonStyle=0)

create_text_block_2 = CreateTextBlock(TextSize=12, Justification=2)
create_label_6 = CreateLabel(LabelText="Bot Message", LabelSize=12, Justification=0)
panel_39 = Panel(create_text_box_5)
create_border_4 = CreateBorder(UIElement=create_text_block_2, BorderThickness=5, BorderColor=RGB(0, 0, 0), CornerRadius=0)
create_stack_7 = CreateStack(UIElements=[create_text_box_5, create_button_3], Horizontal=True)
launch_window_2 = LaunchWindow(Show=Toggle(False), Name="Control Window", Width=370, Height=400, ChildStatus=0, EnableHorizScroll=False)
value_listener_9 = ValueListener(Elements=create_text_box_5, SomeProperty=True)  # -> Values, Indices
value_listener_10 = ValueListener(Elements=create_button_3, SomeProperty=True)  # -> Values, Indices
panel_40 = Panel(value_listener_10.Values)
panel_41 = Panel(value_listener_9.Values)
add_elements_2 = AddElements(Window=launch_window_2, Elements=flatten([create_stack_7, create_label_6, create_text_block_2]), DoVLChecking=True)  # -> AddedElements, ElementNames
stream_freeze_gate_3 = StreamFreezeGate(Data=value_listener_9.Values, PassingSwitch=value_listener_10.Values, Freeze=True)
set_textblock_contents_2 = SetTextBlockContents(TextBlockToModify=create_text_block_2, NewTextBlockContents="ABC")
panel_43 = Panel(stream_freeze_gate_3)
panel_44 = Panel("What is the WWR window to wall ratio for a north facing facade building located in Istambul")
surface = Surface(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)
area_4 = Area(Geometry=surface)  # -> Area, Centroid
boolean_toggle_3 = BooleanToggle(True)
python_3_script_5 = Python3Script(input_area=area_4.Area, run=boolean_toggle_3)  # -> out, out_2; inputs input_area: Double
# ---------- python_3_script_5: Python ----------
# requirements: requests


import requests

url = 'http://localhost:5000/get_from_grasshopper'
payload = {'input': str(input_area)}


out = None
if run:
    response = requests.post(url, json=payload)

    if response.status_code == 200:
        out = "Data was sent to AI Assistant"
    else:
        out = "Failed to connect:"

a = out
# ---------- end python_3_script_5 ----------
python_3_script_6 = Python3Script(run=boolean_toggle_3)  # -> out, a
# ---------- python_3_script_6: Python ----------
# requirements: requests
import requests

# Define the URL for the Flask server endpoint
url = 'http://127.0.0.1:5000/send_to_grasshopper'

# Initialize the output variable
concept_text = 'Has not been generated yet'

# Check if the script should run
if run:
    try:
        # Send a GET request to the Flask server to fetch the data
        response = requests.get(url)

        # Check the response status code
        if response.status_code == 200:
            concept_text = response.json()
            print(f"Received concept: {concept_text}")
        else:
            out = f"Failed to connect: {response.status_code}"
    except Exception as e:
        out = f"Error: {e}"

# Assign the output to a variable for Grasshopper
a = concept_text
# ---------- end python_3_script_6 ----------
python_3_script_7 = Python3Script(input_text=panel_44, run=Toggle(True))  # -> out, out_2
# ---------- python_3_script_7: Python ----------
# requirements: requests


import requests

url = 'http://localhost:5000/llm_call'
payload = {'input': input_text}


out = None
if run:
    response = requests.post(url, json=payload)

    if response.status_code == 200:
        data = response.json()
        out = data['response']
    else:
        out = "Failed to connect:"

a = out
# ---------- end python_3_script_7 ----------
panel_45 = Panel(python_3_script_6.a)
panel_46 = Panel(python_3_script_5.out_2)
panel_47 = Panel(python_3_script_7.out_2)
